% Simulink data dictionary testModel2_td.sldd

params = struct(
  rollCtrlkp_Prad=Simulink.Parameter(Description="[PerRad] Roll controller proportional gain.", Value=1, Min=0, Max=100),
  rollCtrlkd_sPrad=Simulink.Parameter(Description="[secPerRad] Roll controller derivative gain.", Value=0, Min=0, Max=100),
  rollCtrltau_s=Simulink.Parameter(Description="[sec] Roll controller time constant.", Value=0.1, Min=0.025, Max=10),
  pitchCtrlkp_Prad=Simulink.Parameter(Description="[PerRad] Pitch controller proportional gain.", Value=1, Min=0, Max=100),
  pitchCtrlkd_sPrad=Simulink.Parameter(Description="[secPerRad] Pitch controller derivative gain.", Value=0, Min=0, Max=100),
  pitchCtrltau_s=Simulink.Parameter(Description="[sec] Pitch controller time constant.", Value=0.1, Min=0.025, Max=10),
  altCtrlkp_Prad=Simulink.Parameter(Description="[PerRad] Altitude controller proportional gain.", Value=1, Min=0, Max=100),
  altCtrlkd_sPrad=Simulink.Parameter(Description="[secPerRad] Altitude controller derivative gain.", Value=0, Min=0, Max=100),
  altCtrltau_s=Simulink.Parameter(Description="[sec] Altitude controller time constant.", Value=0.1, Min=0.025, Max=10),
  mtr1ManulaSpdCmd_na=Simulink.Parameter(Description="[na] Manual motor 1 speed setting", Value=0, Min=-1, Max=1),
  mtr2ManulaSpdCmd_na=Simulink.Parameter(Description="[na] Manual motor 2 speed setting", Value=0, Min=-1, Max=1),
  mtr3ManulaSpdCmd_na=Simulink.Parameter(Description="[na] Manual motor 3 speed setting", Value=0, Min=-1, Max=1),
  maxOutVltg_vlt=Simulink.Parameter(Description="[V] Maximum analog output voltage.", Value=3.3, Min=0, Max=5),
  initCoMPosVec_cm=Simulink.Parameter(
    Description="[cm] Initial center of mass position vector.",
    Value=[-28 0 35.6],
    Min=-100,
    Max=100,
    Dimensions=[1 3]),
  cameraFOV_deg=Simulink.Parameter(
    Description="[deg] Camera field of view angles from centerline [horiz vert]",
    Value=[30 30],
    Min=0,
    Max=60,
    Dimensions=[1 2]),
  sideCamPosVec_cm=Simulink.Parameter(
    Description="[cm] Side camera position vector.",
    Value=[-27.94 -20.32 38.1],
    Min=-100,
    Max=100,
    Dimensions=[1 3]),
  sideCamEulAng_deg=Simulink.Parameter(
    Description="[deg] Side camera Euler angles, [Roll Pitch Yaw], rotation order is Z, Y, X.",
    Value=[0 90 -90],
    Min=-360,
    Max=360,
    Dimensions=[1 3]),
  botCamPosVec_cm=Simulink.Parameter(
    Description="[cm] Bottom camera position vector.",
    Value=[-27.94 5.08 7.62],
    Min=-100,
    Max=100,
    Dimensions=[1 3]),
  botCamEulAng_deg=Simulink.Parameter(
    Description="[deg] Bottom camera Euler angles, [Roll Pitch Yaw], rotation order is Z, Y, X.",
    Value=[0 180 180],
    Min=-360,
    Max=360,
    Dimensions=[1 3]),
  slntCamPosVec_cm=Simulink.Parameter(
    Description="[cm] Slant camera position vector.",
    Value=[-53.34 5.08 7.62],
    Min=-100,
    Max=100,
    Dimensions=[1 3]),
  slntCamEulAng_deg=Simulink.Parameter(
    Description="[deg] Slant camera Euler angles, [Roll Pitch Yaw], rotation order is Z, Y, X.",
    Value=[0 135 180],
    Min=-360,
    Max=360,
    Dimensions=[1 3]),
  sideDotSepDist_cm=Simulink.Parameter(Description="[cm] Side dots separation distance.", Value=2.54, Min=0, Max=10),
  sideDotPosVec_cm=Simulink.Parameter(
    Description="[cm] Position of side dots centroid in body fixed coordinates",
    Value=[0.091 -4.54 0.878],
    Min=-20,
    Max=20,
    Dimensions=[1 3]),
  botADotSepDist_cm=Simulink.Parameter(Description="[cm] Bottom A dots separation distance.", Value=2.54, Min=0, Max=10),
  botADotPosVec_cm=Simulink.Parameter(
    Description="[cm] Bottom A dots centroid in body fixed coordinates",
    Value=[2.48 0 -4.53],
    Min=-20,
    Max=20,
    Dimensions=[1 3]),
  botBDotSepDist_cm=Simulink.Parameter(Description="[cm] Bottom B dots separation distance.", Value=3.18, Min=0, Max=10),
  botBDotPosVec_cm=Simulink.Parameter(
    Description="[cm] Bottom B dots centroid in body fixed coordinates",
    Value=[9.1 0 -4.64],
    Min=-20,
    Max=20,
    Dimensions=[1 3]),
  imagProcErrThrsh_na=Simulink.Parameter(Description="[NA] Image processing error threshold.", Value=0.5, Min=0, Max=10),
  imagProcErrDbncTm_s=Simulink.Parameter(Description="[s] Image processing error debounce time.", Value=0.1, Min=0, Max=10),
  announceInterval_s=Simulink.Parameter(Description="[s] Announce interval for machine 2", Value=1, Min=0, Max=5),
  roiSideHldPos_px=Simulink.Parameter(
    Description="[px] Default image [row col] coordinates of ROI for side camera.",
    Value=[730 1050],
    Min=0,
    Max=2048,
    Dimensions=[1 2]),
  roiSideSize_px=Simulink.Parameter(
    Description="[px] Default ROI size [row col] for side camera.",
    Value=[90 270],
    Min=0,
    Max=500,
    Dimensions=[1 2]),
  sideImageSize_px=Simulink.Parameter(
    Description="[px] Size of image from side camera [rows cols].",
    Value=[1088 2048],
    Min=0,
    Max=2048,
    Dimensions=[1 2]),
  sideCrsHrWdth_px=Simulink.Parameter(Description="[px] Width of crosshair overlay i   n side image.", Value=1, Min=0, Max=50),
  sideVidStrmDec_na=Simulink.Parameter(
    Description="[NA] Side camera video stream frame decimation (display every N frames).",
    Value=5,
    Min=0,
    Max=50),
  sideVidStrmImgWdth_px=Simulink.Parameter(Description="[px] Side video stream image width", Value=1200, Min=0, Max=5000),
  syncInterval_s=Simulink.Parameter(Description="[s] Sync interval for all machines", Value=0.2, Min=0.08, Max=1),
  offsetThreshold_s=Simulink.Parameter(Description="[s] Offset threshold for all machines", Value=0.00025, Min=1.0e-8, Max=0.01),
  sideIPAddress_na=Simulink.Parameter(
    Description="[NA] Side local IP Address",
    Value=[30 30 30 1],
    Min=0,
    Max=255,
    Dimensions=[1 4]),
  sideToPort_na=Simulink.Parameter(Description="[NA] Side to port address on machine 2", Value=8001, Min=8000, Max=9000),
  sideMinDelay_s=Simulink.Parameter(Description="[s] Side minimum delay between request intervals", Value=2, Min=0, Max=5),
  roiBotAHldPos_px=Simulink.Parameter(
    Description="[px] Default image [row col] coordinates of ROI for bottom A camera.",
    Value=[615 1150],
    Min=0,
    Max=2048,
    Dimensions=[1 2]),
  roiBotBHldPos_px=Simulink.Parameter(
    Description="[px] Default image [row col] coordinates of ROI for bottom B camera.",
    Value=[465 1150],
    Min=0,
    Max=2048,
    Dimensions=[1 2]),
  roiBotASize_px=Simulink.Parameter(
    Description="[px] Default ROI size [row col] for bottom A camera.",
    Value=[180 60],
    Min=0,
    Max=500,
    Dimensions=[1 2]),
  roiBotBSize_px=Simulink.Parameter(
    Description="[px] Default ROI size [row col] for bottom B camera.",
    Value=[54 162],
    Min=0,
    Max=500,
    Dimensions=[1 2]),
  botImageSize_px=Simulink.Parameter(
    Description="[px] Size of image from bottom [rows cols].",
    Value=[1088 2048],
    Min=0,
    Max=2048,
    Dimensions=[1 2]),
  botACrsHrWdth_px=Simulink.Parameter(Description="[px] Width of crosshair overlay in bottom A image.", Value=1, Min=0, Max=50),
  botBCrsHrWdth_px=Simulink.Parameter(Description="[px] Width of crosshair overlay in bottom A image.", Value=1, Min=0, Max=50),
  botVidStrmDec_na=Simulink.Parameter(
    Description="[NA] Bottom camera video stream frame decimation (display every N frames).",
    Value=5,
    Min=0,
    Max=50),
  botVidStrmImgWdth_px=Simulink.Parameter(Description="[px] Bottom video stream image width.", Value=1200, Min=0, Max=5000),
  botVidStrmsrcSwtch_na=Simulink.Parameter(Description="[NA] Bottom video stream source switch.", Value=1, Min=1, Max=2),
  bottomIPAddress_na=Simulink.Parameter(
    Description="[NA] Bottom local IP Address",
    Value=[30 30 30 2],
    Min=0,
    Max=1000,
    Dimensions=[1 4]),
  bottomToPort_na=Simulink.Parameter(Description="[NA] Bottom to port address on machine 2", Value=8002, Min=8000, Max=9000),
  bottomMinDelay_s=Simulink.Parameter(Description="[s] Bottom minimum delay between request intervals", Value=2.5, Min=0, Max=5),
  roiSlntHldPos_px=Simulink.Parameter(
    Description="[px] Default image [row col] coordinates of ROI for slant camera.",
    Value=[460 1170],
    Min=0,
    Max=2048,
    Dimensions=[1 2]),
  roiSlntSize_px=Simulink.Parameter(
    Description="[px] Default ROI size [row col] for slant camera.",
    Value=[60 180],
    Min=0,
    Max=500,
    Dimensions=[1 2]),
  slntImageSize_px=Simulink.Parameter(
    Description="[px] Size of image from slnt camera [rows cols].",
    Value=[1088 2048],
    Min=0,
    Max=2048,
    Dimensions=[1 2]),
  slntCrsHrWdth_px=Simulink.Parameter(Description="[px] Width of crosshair overlay in slant image.", Value=1, Min=0, Max=50),
  slntVidStrmDec_na=Simulink.Parameter(
    Description="[NA] Slant camera video stream frame decimation (display every N frames).",
    Value=5,
    Min=0,
    Max=50),
  slntVidStrmImgWdth_px=Simulink.Parameter(Description="[px] Slant video stream image width.", Value=1200, Min=0, Max=5000),
  slantIPAddress_na=Simulink.Parameter(
    Description="[NA] Slant local IP Address",
    Value=[30 30 30 3],
    Min=0,
    Max=1000,
    Dimensions=[1 4]),
  slantToPort_na=Simulink.Parameter(Description="[NA] Slant to port address on machine 2", Value=8003, Min=8000, Max=9000),
  slantMinDelay_s=Simulink.Parameter(Description="[s] Slant minimum delay between request intervals", Value=2.25, Min=0, Max=5))