% Simulink data dictionary paramsDataDictionary.sldd

altCtrlkd_sPrad = Simulink.Parameter(0, Min=0, Max=100)  % [secPerRad] Altitude controller derivative gain.
altCtrlkp_Prad = Simulink.Parameter(1, Min=0, Max=100)  % [PerRad] Altitude controller proportional gain.
altCtrltau_s = Simulink.Parameter(0.1, Min=0.025, Max=10)  % [sec] Altitude controller time constant.
announceInterval_s = Simulink.Parameter(1, Min=0, Max=5)  % [s] Announce interval for machine 2
botACrsHrWdth_px = Simulink.Parameter(1, Min=0, Max=50)  % [px] Width of crosshair overlay in bottom A image.
botADotPosVec_cm = Simulink.Parameter([2.48 0 -4.53], Min=-20, Max=20)  % [cm] Bottom A dots centroid in body fixed coordinates
botADotSepDist_cm = Simulink.Parameter(1.51, Min=0, Max=10)  % [cm] Bottom A dots separation distance.
botBCrsHrWdth_px = Simulink.Parameter(1, Min=0, Max=50)  % [px] Width of crosshair overlay in bottom A image.
botBDotPosVec_cm = Simulink.Parameter([-1 0 -4.64], Min=-20, Max=20)  % [cm] Bottom B dots centroid in body fixed coordinates
botBDotSepDist_cm = Simulink.Parameter(2.27, Min=0, Max=10)  % [cm] Bottom B dots separation distance.
botCamEulAng_deg = Simulink.Parameter([0 180 180], Min=-360, Max=360)  % [deg] Bottom camera Euler angles, [Roll Pitch Yaw], rotation order is Z, Y, X.
botCamPosVec_cm = Simulink.Parameter([20 1 -3], Min=-100, Max=100)  % [cm] Bottom camera position vector.
botImageSize_px = Simulink.Parameter([1088 2048], Min=0, Max=2048)  % [px] Size of image from bottom [rows cols].
botVidStrmDec_na = Simulink.Parameter(5, Min=0, Max=50)  % [NA] Bottom camera video stream frame decimation (display every N frames).
botVidStrmImgWdth_px = Simulink.Parameter(1200, Min=0, Max=5000)  % [px] Bottom video stream image width.
bottomIPAddress_na = Simulink.Parameter([30 30 30 2], Min=0, Max=1000)  % [NA] Bottom local IP Address
bottomMinDelay_s = Simulink.Parameter(2.5, Min=0, Max=5)  % [s] Bottom minimum delay between request intervals
bottomToPort_na = Simulink.Parameter(8002, Min=8000, Max=9000)  % [NA] Bottom to port address on machine 2
cameraFOV_deg = Simulink.Parameter([42 26], Min=0, Max=60)  % [deg] Camera fielOFd of view angles from centerline [horiz vert]
imagProcErrDbncTm_s = Simulink.Parameter(0.1, Min=0, Max=10)  % [s] Image processing error debounce time.
imagProcErrThrsh_na = Simulink.Parameter(0.25, Min=0, Max=10)  % [NA] Image processing error threshold.
initCoMPosVec_cm = Simulink.Parameter([18 -2 32], Min=-100, Max=100)  % [cm] Initial center of mass position vector.
manualMotorSpeed_na = Simulink.Parameter(0.25, Min=0, Max=1)  % [na] Manual motor speed command, only used in GUI
maxOutVltg_vlt = Simulink.Parameter(3.3, Min=0, Max=5)  % [V] Maximum analog output voltage.
offsetThreshold_s = Simulink.Parameter(0.00025, Min=1.0e-8, Max=0.01)  % [s] Offset threshold for all machines
pitchCtrlkd_sPrad = Simulink.Parameter(0, Min=0, Max=100)  % [secPerRad] Pitch controller derivative gain.
pitchCtrlkp_Prad = Simulink.Parameter(1, Min=0, Max=100)  % [PerRad] Pitch controller proportional gain.
pitchCtrltau_s = Simulink.Parameter(0.1, Min=0.025, Max=10)  % [sec] Pitch controller time constant.
roiBotASize_px = Simulink.Parameter([135 90], Min=0, Max=500)  % [px] Default ROI size [row col] for bottom A camera.
roiBotBSize_px = Simulink.Parameter([30 115], Min=0, Max=500)  % [px] Default ROI size [row col] for bottom B camera.
roiSideSize_px = Simulink.Parameter([90 110], Min=0, Max=500)  % [px] Default ROI size [row col] for side camera.
roiSlntSize_px = Simulink.Parameter([50 100], Min=0, Max=500)  % [px] Default ROI size [row col] for slant camera.
rollCtrlkd_sPrad = Simulink.Parameter(0, Min=0, Max=100)  % [secPerRad] Roll controller derivative gain.
rollCtrlkp_Prad = Simulink.Parameter(1, Min=0, Max=100)  % [PerRad] Roll controller proportional gain.
rollCtrltau_s = Simulink.Parameter(0.1, Min=0.025, Max=10)  % [sec] Roll controller time constant.
sideCamEulAng_deg = Simulink.Parameter([0 90 90], Min=-360, Max=360)  % [deg] Side camera Euler angles, [Roll Pitch Yaw], rotation order is Z, Y, X.
sideCamPosVec_cm = Simulink.Parameter([19 40 43], Min=-100, Max=100)  % [cm] Side camera position vector.
sideCrsHrWdth_px = Simulink.Parameter(1, Min=0, Max=50)  % [px] Width of crosshair overlay i   n side image.
sideDotPosVec_cm = Simulink.Parameter([0.091 4.54 0.878], Min=-20, Max=20)  % [cm] Position of side dots centroid in body fixed coordinates
sideDotSepDist_cm = Simulink.Parameter(2.31, Min=0, Max=10)  % [cm] Side dots separation distance.
sideIPAddress_na = Simulink.Parameter([30 30 30 1], Min=0, Max=255)  % [NA] Side local IP Address
sideImageSize_px = Simulink.Parameter([1088 2048], Min=0, Max=2048)  % [px] Size of image from side camera [rows cols].
sideMinDelay_s = Simulink.Parameter(2, Min=0, Max=5)  % [s] Side minimum delay between request intervals
sideToPort_na = Simulink.Parameter(8001, Min=8000, Max=9000)  % [NA] Side to port address on machine 2
sideVidStrmDec_na = Simulink.Parameter(5, Min=0, Max=50)  % [NA] Side camera video stream frame decimation (display every N frames).
sideVidStrmImgWdth_px = Simulink.Parameter(1200, Min=0, Max=5000)  % [px] Side video stream image width
slantIPAddress_na = Simulink.Parameter([30 30 30 3], Min=0, Max=1000)  % [NA] Slant local IP Address
slantMinDelay_s = Simulink.Parameter(2.25, Min=0, Max=5)  % [s] Slant minimum delay between request intervals
slantToPort_na = Simulink.Parameter(8003, Min=8000, Max=9000)  % [NA] Slant to port address on machine 2
slntCamEulAng_deg = Simulink.Parameter([0 135 180], Min=-360, Max=360)  % [deg] Slant camera Euler angles, [Roll Pitch Yaw], rotation order is Z, Y, X.
slntCamPosVec_cm = Simulink.Parameter([-22 1 -1], Min=-100, Max=100)  % [cm] Slant camera position vector.
slntCrsHrWdth_px = Simulink.Parameter(1, Min=0, Max=50)  % [px] Width of crosshair overlay in slant image.
slntImageSize_px = Simulink.Parameter([1088 2048], Min=0, Max=2048)  % [px] Size of image from slnt camera [rows cols].
slntVidStrmDec_na = Simulink.Parameter(5, Min=0, Max=50)  % [NA] Slant camera video stream frame decimation (display every N frames).
slntVidStrmImgWdth_px = Simulink.Parameter(1200, Min=0, Max=5000)  % [px] Slant video stream image width.
syncInterval_s = Simulink.Parameter(0.2, Min=0.08, Max=1)  % [s] Sync interval for all machines
roiSideHldPos_px = Simulink.Parameter([520 1200], Min=0, Max=2048)  % [px] Default image [row col] coordinates of ROI for side camera.
botVidStrmsrcSwtch_na = Simulink.Parameter(2, Min=1, Max=2)  % [NA] Bottom video stream source switch.
roiSlntHldPos_px = Simulink.Parameter([500 1000], Min=0, Max=2048)  % [px] Default image [row col] coordinates of ROI for slant camera.
mtr1ManulaSpdCmd_na = Simulink.Parameter(0, Min=-1, Max=1)  % [na] Manual motor 1 speed setting
mtr2ManulaSpdCmd_na = Simulink.Parameter(0, Min=-1, Max=1)  % [na] Manual motor 2 speed setting
mtr3ManulaSpdCmd_na = Simulink.Parameter(0, Min=-1, Max=1)  % [na] Manual motor 3 speed setting
operationMode_na = Simulink.Parameter(1, Min=0, Max=1)  % [bool] Control mode: 0 for manual, 1 for automatic
roiBotAHldPos_px = Simulink.Parameter([500 1025], Min=0, Max=2048)  % [px] Default image [row col] coordinates of ROI for bottom A camera.
roiBotBHldPos_px = Simulink.Parameter([360 1035], Min=0, Max=2048)  % [px] Default image [row col] coordinates of ROI for bottom B camera.

params = struct(
  rollCtrlkp_Prad=Simulink.Parameter(Description="[PerRad] Roll controller proportional gain.", Value=1, Min=0, Max=100),
  rollCtrlkd_sPrad=Simulink.Parameter(Description="[secPerRad] Roll controller derivative gain.", Value=0, Min=0, Max=100),
  rollCtrltau_s=Simulink.Parameter(Description="[sec] Roll controller time constant.", Value=0.1, Min=0.025, Max=10),
  pitchCtrlkp_Prad=Simulink.Parameter(Description="[PerRad] Pitch controller proportional gain.", Value=1, Min=0, Max=100),
  pitchCtrlkd_sPrad=Simulink.Parameter(Description="[secPerRad] Pitch controller derivative gain.", Value=0, Min=0, Max=100),
  pitchCtrltau_s=Simulink.Parameter(Description="[sec] Pitch controller time constant.", Value=0.1, Min=0.025, Max=10),
  altCtrlkp_Prad=Simulink.Parameter(Description="[PerRad] Altitude controller proportional gain.", Value=1, Min=0, Max=100),
  altCtrlkd_sPrad=Simulink.Parameter(Description="[secPerRad] Altitude controller derivative gain.", Value=0, Min=0, Max=100),
  altCtrltau_s=Simulink.Parameter(Description="[sec] Altitude controller time constant.", Value=0.1, Min=0.025, Max=10),
  mtr1ManulaSpdCmd_na=Simulink.Parameter(Description="[na] Manual motor 1 speed setting", Value=0, Min=-1, Max=1),
  mtr2ManulaSpdCmd_na=Simulink.Parameter(Description="[na] Manual motor 2 speed setting", Value=0, Min=-1, Max=1),
  mtr3ManulaSpdCmd_na=Simulink.Parameter(Description="[na] Manual motor 3 speed setting", Value=0, Min=-1, Max=1),
  manualMotorSpeed_na=Simulink.Parameter(Description="[na] Manual motor speed command, only used in GUI", Value=0.25, Min=0, Max=1),
  operationMode_na=Simulink.Parameter(Description="[bool] Control mode: 0 for manual, 1 for automatic", Value=1, Min=0, Max=1),
  maxOutVltg_vlt=Simulink.Parameter(Description="[V] Maximum analog output voltage.", Value=3.3, Min=0, Max=5),
  initCoMPosVec_cm=Simulink.Parameter(
    Description="[cm] Initial center of mass position vector.",
    Value=[18 -2 32],
    Min=-100,
    Max=100,
    Dimensions=[1 3]),
  cameraFOV_deg=Simulink.Parameter(
    Description="[deg] Camera fielOFd of view angles from centerline [horiz vert]",
    Value=[42 26],
    Min=0,
    Max=60,
    Dimensions=[1 2]),
  sideCamPosVec_cm=Simulink.Parameter(
    Description="[cm] Side camera position vector.",
    Value=[19 40 43],
    Min=-100,
    Max=100,
    Dimensions=[1 3]),
  sideCamEulAng_deg=Simulink.Parameter(
    Description="[deg] Side camera Euler angles, [Roll Pitch Yaw], rotation order is Z, Y, X.",
    Value=[0 90 90],
    Min=-360,
    Max=360,
    Dimensions=[1 3]),
  botCamPosVec_cm=Simulink.Parameter(
    Description="[cm] Bottom camera position vector.",
    Value=[20 1 -3],
    Min=-100,
    Max=100,
    Dimensions=[1 3]),
  botCamEulAng_deg=Simulink.Parameter(
    Description="[deg] Bottom camera Euler angles, [Roll Pitch Yaw], rotation order is Z, Y, X.",
    Value=[0 180 180],
    Min=-360,
    Max=360,
    Dimensions=[1 3]),
  slntCamPosVec_cm=Simulink.Parameter(
    Description="[cm] Slant camera position vector.",
    Value=[-22 1 -1],
    Min=-100,
    Max=100,
    Dimensions=[1 3]),
  slntCamEulAng_deg=Simulink.Parameter(
    Description="[deg] Slant camera Euler angles, [Roll Pitch Yaw], rotation order is Z, Y, X.",
    Value=[0 135 180],
    Min=-360,
    Max=360,
    Dimensions=[1 3]),
  sideDotSepDist_cm=Simulink.Parameter(Description="[cm] Side dots separation distance.", Value=2.31, Min=0, Max=10),
  sideDotPosVec_cm=Simulink.Parameter(
    Description="[cm] Position of side dots centroid in body fixed coordinates",
    Value=[0.091 4.54 0.878],
    Min=-20,
    Max=20,
    Dimensions=[1 3]),
  botADotSepDist_cm=Simulink.Parameter(Description="[cm] Bottom A dots separation distance.", Value=1.51, Min=0, Max=10),
  botADotPosVec_cm=Simulink.Parameter(
    Description="[cm] Bottom A dots centroid in body fixed coordinates",
    Value=[2.48 0 -4.53],
    Min=-20,
    Max=20,
    Dimensions=[1 3]),
  botBDotSepDist_cm=Simulink.Parameter(Description="[cm] Bottom B dots separation distance.", Value=2.27, Min=0, Max=10),
  botBDotPosVec_cm=Simulink.Parameter(
    Description="[cm] Bottom B dots centroid in body fixed coordinates",
    Value=[-1 0 -4.64],
    Min=-20,
    Max=20,
    Dimensions=[1 3]),
  imagProcErrThrsh_na=Simulink.Parameter(Description="[NA] Image processing error threshold.", Value=0.25, Min=0, Max=10),
  imagProcErrDbncTm_s=Simulink.Parameter(Description="[s] Image processing error debounce time.", Value=0.1, Min=0, Max=10),
  announceInterval_s=Simulink.Parameter(Description="[s] Announce interval for machine 2", Value=1, Min=0, Max=5),
  roiSideHldPos_px=Simulink.Parameter(
    Description="[px] Default image [row col] coordinates of ROI for side camera.",
    Value=[450 960],
    Min=0,
    Max=2048,
    Dimensions=[1 2]),
  roiSideSize_px=Simulink.Parameter(
    Description="[px] Default ROI size [row col] for side camera.",
    Value=[90 110],
    Min=0,
    Max=500,
    Dimensions=[1 2]),
  sideImageSize_px=Simulink.Parameter(
    Description="[px] Size of image from side camera [rows cols].",
    Value=[1088 2048],
    Min=0,
    Max=2048,
    Dimensions=[1 2]),
  sideCrsHrWdth_px=Simulink.Parameter(Description="[px] Width of crosshair overlay i   n side image.", Value=1, Min=0, Max=50),
  sideVidStrmDec_na=Simulink.Parameter(
    Description="[NA] Side camera video stream frame decimation (display every N frames).",
    Value=5,
    Min=0,
    Max=50),
  sideVidStrmImgWdth_px=Simulink.Parameter(Description="[px] Side video stream image width", Value=1200, Min=0, Max=5000),
  syncInterval_s=Simulink.Parameter(Description="[s] Sync interval for all machines", Value=0.2, Min=0.08, Max=1),
  offsetThreshold_s=Simulink.Parameter(Description="[s] Offset threshold for all machines", Value=0.00025, Min=1.0e-8, Max=0.01),
  sideIPAddress_na=Simulink.Parameter(
    Description="[NA] Side local IP Address",
    Value=[30 30 30 1],
    Min=0,
    Max=255,
    Dimensions=[1 4]),
  sideToPort_na=Simulink.Parameter(Description="[NA] Side to port address on machine 2", Value=8001, Min=8000, Max=9000),
  sideMinDelay_s=Simulink.Parameter(Description="[s] Side minimum delay between request intervals", Value=2, Min=0, Max=5),
  roiBotAHldPos_px=Simulink.Parameter(
    Description="[px] Default image [row col] coordinates of ROI for bottom A camera.",
    Value=[580 1060],
    Min=0,
    Max=2048,
    Dimensions=[1 2]),
  roiBotBHldPos_px=Simulink.Parameter(
    Description="[px] Default image [row col] coordinates of ROI for bottom B camera.",
    Value=[450 1050],
    Min=0,
    Max=2048,
    Dimensions=[1 2]),
  roiBotASize_px=Simulink.Parameter(
    Description="[px] Default ROI size [row col] for bottom A camera.",
    Value=[135 90],
    Min=0,
    Max=500,
    Dimensions=[1 2]),
  roiBotBSize_px=Simulink.Parameter(
    Description="[px] Default ROI size [row col] for bottom B camera.",
    Value=[30 115],
    Min=0,
    Max=500,
    Dimensions=[1 2]),
  botImageSize_px=Simulink.Parameter(
    Description="[px] Size of image from bottom [rows cols].",
    Value=[1088 2048],
    Min=0,
    Max=2048,
    Dimensions=[1 2]),
  botACrsHrWdth_px=Simulink.Parameter(Description="[px] Width of crosshair overlay in bottom A image.", Value=1, Min=0, Max=50),
  botBCrsHrWdth_px=Simulink.Parameter(Description="[px] Width of crosshair overlay in bottom A image.", Value=1, Min=0, Max=50),
  botVidStrmDec_na=Simulink.Parameter(
    Description="[NA] Bottom camera video stream frame decimation (display every N frames).",
    Value=5,
    Min=0,
    Max=50),
  botVidStrmImgWdth_px=Simulink.Parameter(Description="[px] Bottom video stream image width.", Value=1200, Min=0, Max=5000),
  botVidStrmsrcSwtch_na=Simulink.Parameter(Description="[NA] Bottom video stream source switch.", Value=1, Min=1, Max=2),
  bottomIPAddress_na=Simulink.Parameter(
    Description="[NA] Bottom local IP Address",
    Value=[30 30 30 2],
    Min=0,
    Max=1000,
    Dimensions=[1 4]),
  bottomToPort_na=Simulink.Parameter(Description="[NA] Bottom to port address on machine 2", Value=8002, Min=8000, Max=9000),
  bottomMinDelay_s=Simulink.Parameter(Description="[s] Bottom minimum delay between request intervals", Value=2.5, Min=0, Max=5),
  roiSlntHldPos_px=Simulink.Parameter(
    Description="[px] Default image [row col] coordinates of ROI for slant camera.",
    Value=[560 1050],
    Min=0,
    Max=2048,
    Dimensions=[1 2]),
  roiSlntSize_px=Simulink.Parameter(
    Description="[px] Default ROI size [row col] for slant camera.",
    Value=[50 100],
    Min=0,
    Max=500,
    Dimensions=[1 2]),
  slntImageSize_px=Simulink.Parameter(
    Description="[px] Size of image from slnt camera [rows cols].",
    Value=[1088 2048],
    Min=0,
    Max=2048,
    Dimensions=[1 2]),
  slntCrsHrWdth_px=Simulink.Parameter(Description="[px] Width of crosshair overlay in slant image.", Value=1, Min=0, Max=50),
  slntVidStrmDec_na=Simulink.Parameter(
    Description="[NA] Slant camera video stream frame decimation (display every N frames).",
    Value=5,
    Min=0,
    Max=50),
  slntVidStrmImgWdth_px=Simulink.Parameter(Description="[px] Slant video stream image width.", Value=1200, Min=0, Max=5000),
  slantIPAddress_na=Simulink.Parameter(
    Description="[NA] Slant local IP Address",
    Value=[30 30 30 3],
    Min=0,
    Max=1000,
    Dimensions=[1 4]),
  slantToPort_na=Simulink.Parameter(Description="[NA] Slant to port address on machine 2", Value=8003, Min=8000, Max=9000),
  slantMinDelay_s=Simulink.Parameter(Description="[s] Slant minimum delay between request intervals", Value=2.25, Min=0, Max=5))